% Simulink data dictionary asbCubeSatModelData.sldd

vehicle = struct(mass=1, inertia=[1 0 0; 0 1 0; 0 0 1])

ACSOutBus = Simulink.Bus()
  AttitudeError: AttitudeErrorBus
  TorqueCmds: double[3]
  cmd_q_b2tgt: double[4]
  NavMode: double

FCSOutBus = Simulink.Bus()
  ACSOut: ACSOutBus

AttitudeErrorBus = Simulink.Bus()
  Roll: double
  Pitch: double
  Yaw: double

EnvBus = Simulink.Bus()
  envAccel_ecef: double[3]
  envForces_body: double[3]
  envTorques_body: double[3]
  x_sun_eci: double[3]
  earthAngRate: double[3]

gains = struct(Kp=5.5e-5, Ki=0, Kd=0.017)

StatesOutBus = Simulink.Bus()
  utc_JD: double
  X_ecef: double[3]
  V_ecef: double[3]
  X_eci: double[3]
  V_eci: double[3]
  q_ecef2b: double[4]
  q_eci2b: double[4]
  Euler: double[3]
  LatLonAlt: double[3]
  SunAngle: double
  SunInView: boolean

CubeSatTimeStep = 1

initCond = struct(
  simStartDate=struct(JD=2460676.5, dateVector=[2025 1 1 0 0 0]),
  CoordEpoch=struct(JD=2460676.5, dateVector=[2025 1 1 0 0 0]),
  OrbitalElements=struct(
    semiMajorAxis=6786233.13,
    eccentricity=7.1e-5,
    inclination=141.6,
    RAAN=92.58,
    argumentOfPerigee=349.1886,
    trueAnomoly=15,
    trueLongitude=0,
    argumentOfLatititude=0,
    longitudeOfPerigee=0),
  r_eci=[83388.36 6778268 307860],
  v_eci=[6009.71 -289.444 4748.083],
  r_ecef=[6655311 -1287788 308356.3],
  v_ecef=[-1444.994 -6324.609 4777.223],
  lla=[2.620979 -10.95127 407675.1],
  v_ned=[4782.157 -6483.944 -1.515405],
  uvw=[4782.157 -6483.944 -1.515405],
  euler=[0 0 0],
  pqr=[0 0 0])