% Simulink data dictionary asbCubeSatModelData.sldd

vehicle = struct(mass=1, inertia=[1 0 0; 0 1 0; 0 0 1])

ACSOutBus = Simulink.Bus()
  AttitudeError: AttitudeErrorBus
  TorqueCmds: double[3]
  cmd_q_b2tgt: double[4]
  NavMode: double

FCSOutBus = Simulink.Bus()
  ACSOut: ACSOutBus

AttitudeErrorBus = Simulink.Bus()
  Roll: double
  Pitch: double
  Yaw: double

EnvBus = Simulink.Bus()
  envAccel_ecef: double[3]
  envForces_body: double[3]
  envTorques_body: double[3]
  x_sun_eci: double[3]
  earthAngRate: double[3]

gains = struct(Kp=5.5e-5, Ki=0, Kd=0.017)

StatesOutBus = Simulink.Bus()
  utc_JD: double
  X_ecef: double[3]
  V_ecef: double[3]
  X_eci: double[3]
  V_eci: double[3]
  q_ecef2b: double[4]
  q_eci2b: double[4]
  Euler: double[3]
  LatLonAlt: double[3]
  SunAngle: double
  SunInView: boolean

CubeSatTimeStep = 1

initCond = struct(
  simStartDate=struct(JD=2458485, dateVector=[2019 1 1 12 0 0]),
  CoordEpoch=struct(JD=2451545, dateVector=[2000 1 1 12 0 0]),
  OrbitalElements=struct(
    semiMajorAxis=6786233.13,
    eccentricity=7.1e-5,
    inclination=51.6,
    RAAN=92.58,
    argumentOfPerigee=349.1886,
    trueAnomoly=10.8949,
    trueLongitude=0,
    argumentOfLatititude=0,
    longitudeOfPerigee=0),
  r_eci=[-311592.2 6778598 7750.12],
  v_eci=[-4755.469 -225.3595 6006.625],
  r_ecef=[-6720084 941787.2 7002.631],
  v_ecef=[-587.5528 -4236.316 5997.981],
  lla=[0.05950135 172.0222 407623],
  v_ned=[5997.984 4276.862 -0.1420409],
  uvw=[5997.984 4276.862 -0.1420409],
  euler=[0 0 0],
  pqr=[0 0 0])